# Grasshopper definition Test1.ghx (Grasshopper 1.0.8)
# Copyright: Copyright 2024 Corgan Associates, Inc

# Corgan Practice Technology Grasshopper Template 0.1
number_slider = Slider(10, range=0..50)
populate_3d = Populate3D(Region={Plane=PlaneXY(0, 0, 0), X=Domain(0, 10), Y=Domain(0, 10), Z=Domain(0, 2)}, Count=number_slider, Seed=1)
text = Text()
panel = Panel(text)
panel_2 = Panel(populate_3d)
sphere = Sphere(Base=panel_2, Radius=1)
sphere_2 = Sphere(Base=panel_2, Radius=1)
